# Grasshopper definition 모델링 그래스하퍼.gh (Grasshopper 1.0.7)

point = Point(<point referenced from the Rhino model>)

curve = Curve(<curve referenced from the Rhino model>)
area = Area(Geometry=curve)  # -> Area, Centroid
scale = Scale(Geometry=curve, Center=area.Centroid, Factor=Slider(0.84, range=0..1))  # -> Geometry, Transform
loft = Loft(
    Curves=flatten([curve, scale.Geometry]),
    Options={Adjust=False, Closed=False, LoftEnds=0, LoftSimp=0, LoftType=0, Rebuild=10, Refit=0.01})
number_slider = Slider(105500, range=0..500000)
unit_z = UnitZ(Factor=number_slider)
extrude = Extrude(Base=curve, Direction=unit_z)
extrude_2 = Extrude(Base=loft, Direction=unit_z)

negative = Negative(Value=Slider(550, range=0..1000))
negative_2 = Negative(Value=Slider(580, range=0..1000))
plane_surface = PlaneSurface(Plane=area.Centroid, XSize=Slider(1040, range=0..5000), YSize=Slider(1200, range=0..5000))
unit_x = UnitX(Factor=negative)
move = Move(Geometry=plane_surface, Motion=unit_x)  # -> Geometry, Transform
unit_y = UnitY(Factor=negative_2)
move_2 = Move(Geometry=move.Geometry, Motion=unit_y)  # -> Geometry, Transform
area_2 = Area(Geometry=move_2.Geometry)  # -> Area, Centroid
scale_2 = Scale(Geometry=move_2.Geometry, Center=area_2.Centroid, Factor=Slider(10, range=0..10))  # -> Geometry, Transform
fillet = Fillet(Curve=scale_2.Geometry, Radius=Slider(1000, range=0..1000))
area_3 = Area(Geometry=fillet)  # -> Area, Centroid
scale_3 = Scale(Geometry=fillet, Center=area_3.Centroid, Factor=Slider(0.95, range=0..1))  # -> Geometry, Transform

length = Length(Curve=curve)
md_slider = MDSlider(SliderMode=0, slider_value=Point(0.5, 0.5, 0.5), x_domain=Domain(0, 1), y_domain=Domain(0, 1), z_domain=Domain(0, 1))
md_slider_2 = MDSlider(
    SliderMode=0,
    slider_value=Point(0.2130560526, 0.2369682498, 0.5),
    x_domain=Domain(0, 1),
    y_domain=Domain(0, 1),
    z_domain=Domain(0, 1))
plane_surface_2 = PlaneSurface(Plane=point, XSize=length, YSize=number_slider)
evaluate_surface = EvaluateSurface(Surface=reparameterize(plane_surface_2), Point=[md_slider_2, md_slider])  # -> Point, Normal, UDirection, VDirection, Frame
number_slider_2 = Slider(10000, range=0..10000)
plane_surface_3 = PlaneSurface(Plane=evaluate_surface.Point, XSize=number_slider_2, YSize=number_slider_2)
extrude_3 = Extrude(Base=plane_surface_3)

negative_3 = Negative(Value=Slider(400, range=0..1000))
unit_z_2 = UnitZ(Factor=negative_3)
extrude_4 = Extrude(Base=scale.Geometry, Direction=unit_z_2)
cap_holes = CapHoles(Brep=extrude_4)
unit_z_3 = UnitZ(Factor=negative_3)
extrude_5 = Extrude(Base=fillet, Direction=unit_z_3)
cap_holes_2 = CapHoles(Brep=extrude_5)
solid_difference = SolidDifference(BrepsA=cap_holes, BrepsB=cap_holes_2)

unit_z_4 = UnitZ(Factor=Slider(4000, range=0..10000))
move_3 = Move(Geometry=solid_difference, Motion=unit_z_4)  # -> Geometry, Transform
unit_z_5 = UnitZ(Factor=Slider(2800, range=0..10000))
move_4 = Move(Geometry=move_3.Geometry, Motion=unit_z_5)  # -> Geometry, Transform
unit_z_6 = UnitZ(Factor=Slider(4000, range=0..10000))
unit_z_7 = UnitZ(Factor=Slider(88800, range=0..100000))
move_5 = Move(Geometry=move_4.Geometry, Motion=unit_z_7)  # -> Geometry, Transform
linear_array = LinearArray(Geometry=move_4.Geometry, Direction=unit_z_6, Count=Slider(22, range=0..100))  # -> Geometry, Transform

loft_2 = Loft(
    Curves=[fillet, scale_3.Geometry],
    Options={Adjust=False, Closed=False, LoftEnds=0, LoftSimp=0, LoftType=0, Rebuild=10, Refit=0.01})
multiplication = Multiplication(A=Slider(4000, range=0..10000), B=Slider(22, range=0..100))
multiplication_2 = Multiplication(A=Slider(6500, range=0..10000), B=Slider(2, range=0..10))
addition = Addition(A=multiplication, B=multiplication_2)
unit_z_8 = UnitZ(Factor=addition)
extrude_6 = Extrude(Base=loft_2, Direction=unit_z_8)
